test file "test1"

suite "model test"

  case "TestConstant" [baseline]
    model model, harness model_Harness2 (for model/Model)
    signal scenario: ConstantInput (model_Harness2/Harness Inputs)
    assessment "Assessment1": At any point of time, dinerror must be greater than -2.4 and less than 2.4
    assessment "Assessment2": At any point of time, poloshenie must be greater than -2.4 and less than 2.4
      poloshenie: signal model_Harness2/Output Conversion Subsystem, port 1
      dinerror: signal model_Harness2/Output Conversion Subsystem, port 2

  case "TestSine" [baseline]
    model model, harness model_Harness2 (for model/Model)
    signal scenario: SineInput (model_Harness2/Harness Inputs)
    assessment "Assessment1": At any point of time, poloshenie must be greater than -2.4 and less than -2.4
    assessment "Assessment2": At any point of time, dinerror must be greater than -2.4 and less than 2.4
      poloshenie: signal model_Harness2/Output Conversion Subsystem, port 1
      dinerror: signal model_Harness2/Output Conversion Subsystem, port 2

  case "TestPulse" [baseline]
    model model, harness model_Harness2 (for model/Model)
    signal scenario: PulseInput (model_Harness2/Harness Inputs)
    assessment "Assessment1": At any point of time, poloshenie must be greater than -2.4 and less than 2.4
    assessment "Assessment2": At any point of time, dinerror must be greater than -2.4 and less than 2.4
      poloshenie: signal model_Harness2/Output Conversion Subsystem, port 1
      dinerror: signal model_Harness2/Output Conversion Subsystem, port 2